# Grasshopper definition 210819_HopsLauncher_GrasshopperDevelopment.gh (Grasshopper 1.0.7)
# plug-ins: Weaverbird, Hops

internalizedstanfordbunny = Mesh(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)
internalizeddemorock = Mesh(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)
internalizedstanfordbunny_2 = Mesh(internalizedstanfordbunny)

translationdistance = Slider(6, range=0..100)
rotationangle = Slider(53, range=0..360)

# ----
# http://localhost:5000/icp.RegisterPointClouds
# Reconstruct Transformation Matrix from Hops Output (Rhino.transform can't be output through Hops yet...)
demorock = Mesh(internalizeddemorock)
X = UnitX(Factor="6")  # -> expr("x*4", UnitVector)
move = Move(Geometry=demorock, Motion=X)  # -> Geometry, Transform
wbsplitquads = WeaverbirdsConstantQuadsSplitSubdivision(MeshCurves=move.Geometry, Level=1, SmoothNakedEdges=1)
demesh = DeconstructMesh(Mesh=wbsplitquads)  # -> Vertices, Faces, Colours, Normals
wbmeshvertices = Point(demesh.Vertices)
Y = UnitY(Factor=translationdistance)
avr = Average(Input=wbmeshvertices)
demomesh = Mesh(move.Geometry)
wbmesh = Mesh(wbsplitquads)
rotationaxist = Vector(Vector(-0.4156669971, -0.6517605954, -0.6343729769))
move_2 = Move(Geometry=demomesh, Motion=Y)  # -> Geometry, Transform
move_3 = Move(Geometry=wbmesh, Motion=Y)  # -> Geometry, Transform
move_4 = Move(Geometry=avr, Motion=Y)  # -> Geometry, Transform
rot3d = Rotate3D(Geometry=move_3.Geometry, Angle=degrees(rotationangle), Center=move_4.Geometry, Axis=rotationaxist)  # -> Geometry, Transform
rot3d_2 = Rotate3D(Geometry=move_2.Geometry, Angle=degrees(rotationangle), Center=move_4.Geometry, Axis=rotationaxist)  # -> Geometry, Transform
select_scene_points = ValueList({"Identical n. of Points": 0, "Less n. Points": 1}, selected="Less n. Points")
demomeshtransrot = Mesh(rot3d_2.Geometry)
wbmeshtransrot = Mesh(rot3d.Geometry)
filter = StreamFilter(Gate=select_scene_points, Stream0=wbmeshtransrot, Stream1=demomeshtransrot)
demesh_2 = DeconstructMesh(Mesh=filter)  # -> Vertices, Faces, Colours, Normals
nearest_neighnor_algorithm = ValueList({"KNN": 0, "Hungarian": 1}, selected="KNN")
modelpoints = Point(wbmeshvertices)
scenepoints = Point(demesh_2.Vertices)
hops = Hops(
    ScenePoints=scenepoints,
    ModelPoints=modelpoints,
    Threshold="1e-3",
    MaxIterations=Slider(30, range=0..100),
    NNAlgorithm=nearest_neighnor_algorithm,
    CacheResultsInMemory=False,
    CacheSolveResults=False,
    RemoteDefinitionLocation="http://localhost:5000/icp.RegisterPointClouds",
    RemoteSolveVersion=(0, 1, 0),
    ShowInput_Enabled=False,
    ShowInput_Path=False,
    SynchronousSolve=False)  # -> RegisteredPoints, Transform, Error, Iterations
matrix = ConstructMatrix(Rows=4, Columns=4, Values=hops.Transform)
mean_error = Panel(hops.Error)
iterations_before_termination = Panel(hops.Iterations)
registeredpoints = Point(hops.RegisteredPoints)
demomesh_2 = Mesh(move.Geometry)
matrix_2 = TransformMatrix(matrix, Digits=3)
preview = CustomPreview(Geometry=filter, Material=ColourSwatch(SwatchColor=RGB(58, 142, 252)))
preview_2 = CustomPreview(Geometry=demomesh_2, Material=ColourSwatch(SwatchColor=RGB(101, 255, 255)))
preview_3 = CustomPreview(Geometry=registeredpoints, Material=ColourSwatch(SwatchColor=RGB(255, 0, 255)))

demorock_2 = Mesh(internalizeddemorock)
wbsplitquads_2 = WeaverbirdsConstantQuadsSplitSubdivision(MeshCurves=demorock_2, Level=2, SmoothNakedEdges=1)
tri = Triangulate(Mesh=wbsplitquads_2)  # -> Mesh, Count
X_2 = UnitX(Factor="6")  # -> expr("x*3", UnitVector)
move_5 = Move(Geometry=tri.Mesh, Motion=X_2)  # -> Geometry, Transform
demesh_3 = DeconstructMesh(Mesh=move_5.Geometry)  # -> Vertices, Faces, Colours, Normals

# ----
# http://localhost:5000/intri.HeatMethodDistance
number_slider = Slider(235, range=0..1000)
hops_2 = Hops(
    Mesh=move_5.Geometry,
    SourceVertex=number_slider,
    TextureScale=1,
    CacheResultsInMemory=False,
    CacheSolveResults=False,
    RemoteDefinitionLocation="http://localhost:5000/intri.HeatMethodDistance",
    RemoteSolveVersion=(0, 1, 0),
    ShowInput_Enabled=False,
    ShowInput_Path=False,
    SynchronousSolve=False)  # -> Mesh, Distances, Values

gradient = Gradient(
    LowerLimit=1,
    UpperLimit=0,
    Parameter=hops_2.Values,
    stops=[0: RGB(243, 57, 0), 0.1: RGB(236, 27, 60), 0.2: RGB(210, 0, 118), 0.3: RGB(103, 0, 120), 0.4: RGB(39, 72, 161), 0.5: RGB(1, 192, 229), 0.6: RGB(18, 178, 90), 0.7: RGB(79, 186, 8), 0.8: RGB(220, 237, 32), 0.9: RGB(247, 159, 20), 1: RGB(243, 57, 0)])
conmesh = ConstructMesh(Vertices=demesh_3.Vertices, Faces=demesh_3.Faces, Colours=gradient)
item = ListItem(List=demesh_3.Vertices, Index=number_slider, Wrap=True)
preview_4 = CustomPreview(
    Geometry=conmesh,
    Material={diffuse=RGB(221, 160, 221), emission=RGB(66, 48, 66), shine=0.5, specular=RGB(255, 255, 255), transparency=0})
dots = DotDisplay(Point=item, Colour=RGB(0, 0, 0), Size=0.1)

demorock_3 = Mesh(internalizeddemorock)
X_3 = UnitX(Factor="0")
move_6 = Move(Geometry=demorock_3, Motion=X_3)  # -> Geometry, Transform
popgeo = PopulateGeometry(Geometry=move_6.Geometry, Count=Slider(2000, range=0..10000), Seed=1)
meshcp = MeshClosestPoint(Point=popgeo, Mesh=move_6.Geometry)  # -> Point, Index, Parameter
meval = MeshEval(Mesh=move_6.Geometry, Parameter=meshcp.Parameter)  # -> Point, Normal, Colour

panel = Panel("http://localhost:5000/open3d.PoissonMeshNormals")
hops_3 = Hops(
    Points=meval.Point,
    Normals=meval.Normal,
    Depth=8,
    Width=0,
    Scale=1.1,
    LinearFit=False,
    CacheResultsInMemory=False,
    CacheSolveResults=False,
    RemoteDefinitionLocation="http://localhost:5000/open3d.PoissonMeshNormals",
    RemoteSolveVersion=(0, 1, 0),
    ShowInput_Enabled=False,
    ShowInput_Path=False,
    SynchronousSolve=False)

preview_5 = CustomPreview(Geometry=hops_3, Material=ColourSwatch(SwatchColor=RGB(159, 224, 227)))

demorock_4 = Mesh(internalizeddemorock)
X_4 = UnitX(Factor="6")  # -> expr("x*2", UnitVector)
move_7 = Move(Geometry=demorock_4, Motion=X_4)  # -> Geometry, Transform
wbsplitquads_3 = WeaverbirdsConstantQuadsSplitSubdivision(MeshCurves=move_7.Geometry, Level=2, SmoothNakedEdges=1)
tri_2 = Triangulate(Mesh=wbsplitquads_3)  # -> Mesh, Count

# ----
# http://localhost:5000/intri.IntrinsicTriangulation
hops_4 = Hops(
    Mesh=tri_2.Mesh,
    CacheResultsInMemory=False,
    CacheSolveResults=False,
    RemoteDefinitionLocation="http://localhost:5000/intri.IntrinsicTriangulation",
    RemoteSolveVersion=(0, 1, 0),
    ShowInput_Enabled=False,
    ShowInput_Path=False,
    SynchronousSolve=False)

preview_6 = CustomPreview(Geometry=hops_4, Material=ColourSwatch(SwatchColor=RGB(159, 224, 227)))

demorock_5 = Mesh(internalizeddemorock)
X_5 = UnitX(Factor="6")
move_8 = Move(Geometry=demorock_5, Motion=X_5)  # -> Geometry, Transform
demesh_4 = DeconstructMesh(Mesh=move_8.Geometry)  # -> Vertices, Faces, Colours, Normals

panel_2 = Panel("http://localhost:5000/open3d.PoissonMesh")
hops_5 = Hops(
    Points=demesh_4.Vertices,
    Depth=8,
    Width=0,
    Scale=1.1,
    LinearFit=False,
    CacheResultsInMemory=False,
    CacheSolveResults=False,
    RemoteDefinitionLocation="http://localhost:5000/open3d.PoissonMesh",
    RemoteSolveVersion=(0, 1, 0),
    ShowInput_Enabled=False,
    ShowInput_Path=False,
    SynchronousSolve=False)

preview_7 = CustomPreview(Geometry=hops_5, Material=ColourSwatch(SwatchColor=RGB(159, 224, 227)))
