# Grasshopper definition 210914_HopsServerUpdater.gh (Grasshopper 1.0.7)

python = GhPythonScript(Server="127.0.0.1:5000", UpdateServer=Toggle(False))  # -> Results; inputs UpdateServer: Boolean
# ---------- python: Python ----------
"""
Updates the server of all Hops Components on the canvas.
    Inputs:
        Server: The ip / address of the server, including the port.
        UpdateServer: Set to True to update all Hops Components on the canvas.
    Output:
        Results: A textual description on which Hops Components have been
                 updated
"""

import Grasshopper as gh
ghdoc = ghenv.Component.OnPingDocument()

error = gh.Kernel.GH_RuntimeMessageLevel.Error
warning = gh.Kernel.GH_RuntimeMessageLevel.Warning
remark = gh.Kernel.GH_RuntimeMessageLevel.Remark

Results = []
if Server and UpdateServer:
    
    # sanitize server string
    if Server.startswith("http://"):
        Server = Server[7:]
    elif Server.startswith("https://"):
        Server = Server[8:]
    
    guids = []
    for obj in ghdoc.Objects:
        if repr(obj).startswith("<Hops.HopsComponent"):
            # get instance guid as string
            ig = str(obj.InstanceGuid)
            # in case there is no remote definition
            if not obj.RemoteDefinitionLocation:
                msg = ("Hops Component with GUID {0} was NOT updated because"
                       "its path is unset!").format(ig)
                obj.AddRuntimeMessage(error, "This " + msg)
                Results.append(msg)
            # if there is a http or https server set
            elif (obj.RemoteDefinitionLocation.startswith("http://") or
                  obj.RemoteDefinitionLocation.startswith("https://")):
                # split the string of the remote location
                parts = obj.RemoteDefinitionLocation.split("/")
                # insert new server into split list
                parts[2] = Server
                newloc = "/".join(parts)
                # set new server location to hops component
                obj.RemoteDefinitionLocation = newloc
                # create message
                msg = ("Hops Component with GUID {0} was updated with new "
                       "server path {1}!").format(ig, Server)
                obj.AddRuntimeMessage(remark, "This " + msg)
                Results.append(msg)
            # in other cases
            else:
                msg = ("Hops Component with GUID {0} was NOT updated because "
                       "its path is not set to a server!").format(ig)
                obj.AddRuntimeMessage(error, "This " + msg)
                Results.append(msg)
# ---------- end python ----------
panel = Panel(python)
