# Grasshopper definition 211203_MALT_GrasshopperDevelopment.gh (Grasshopper 1.0.7)
# plug-ins: Weaverbird, Hops

# ----
# Attempt to update all Hops components on the canvas with a given server path.
panel = Panel("localhost:5000")
uhsp = UpdateHopsServerPaths(Server=panel, Update=Toggle(False))  # -> Results; inputs Update: Boolean
# ---------- uhsp: Python ----------
"""
Attempts to update the server path of all Hops Components on the canvas.
    Inputs:
        Server: The ip / address of the server, including the port.
        Update: Set to True to update all Hops Components on the canvas.
    Output:
        Results: A textual description on which Hops Components have been
                 updated
    Remarks:
        Author: Max Eschenbach
        License: MIT License
        Version: 210917
"""

# GHPYTHON SDK IMPORTS
from ghpythonlib.componentbase import executingcomponent as component
import Grasshopper, GhPython
import System
import Rhino
import rhinoscriptsyntax as rs

# GHENV COMPONENT SETTINGS
ghenv.Component.Name = "UpdateHopsServerPaths"
ghenv.Component.NickName = "UHSP"
ghenv.Component.Category = "Malt"
ghenv.Component.SubCategory = "10 Utilities"

class UpdateHopsServerPaths(component):
    
    def RunScript(self, Server, Update):
        
        ghdoc = self.OnPingDocument()
        
        error = self.RuntimeMessageLevel.Error
        warning = self.RuntimeMessageLevel.Warning
        remark = self.RuntimeMessageLevel.Remark
        
        Results = []
        if Server and Update:
            
            # sanitize server string
            if Server.startswith("http://"):
                Server = Server[7:]
            elif Server.startswith("https://"):
                Server = Server[8:]
            
            for obj in ghdoc.Objects:
                if repr(obj).startswith("<Hops.HopsComponent"):
                    # get instance guid as string
                    ig = str(obj.InstanceGuid)
                    # in case there is no remote definition
                    if not obj.RemoteDefinitionLocation:
                        msg = ("Hops Component with GUID {0} was NOT updated because"
                               "its path is unset!").format(ig)
                        obj.AddRuntimeMessage(error, "This " + msg)
                        Results.append(msg)
                    # if there is a http or https server set
                    elif (obj.RemoteDefinitionLocation.startswith("http://") or
                          obj.RemoteDefinitionLocation.startswith("https://")):
                        # split the string of the remote location
                        parts = obj.RemoteDefinitionLocation.split("/")
                        # insert new server into split list
                        parts[2] = Server
                        newloc = "/".join(parts)
                        # set new server location to hops component
                        obj.RemoteDefinitionLocation = newloc
                        # create message
                        msg = ("Hops Component with GUID {0} was updated with new "
                               "server path {1}!").format(ig, Server)
                        obj.AddRuntimeMessage(remark, "This " + msg)
                        Results.append(msg)
                    # in other cases
                    else:
                        msg = ("Hops Component with GUID {0} was NOT updated because "
                               "its path is not set to a server!").format(ig)
                        obj.AddRuntimeMessage(error, "This " + msg)
                        Results.append(msg)
        
        # return outputs if you have them; here I try it for you:
        return Results
# ---------- end uhsp ----------
panel_2 = Panel(uhsp)

internalizedstanfordbunny = Mesh(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)
internalizeddemorock = Mesh(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)
internalizedstanfordbunny_2 = Mesh(internalizedstanfordbunny)

# ----
# List all URI's of the Components available on the Hops Server as well as their descriptions
# http://localhost:5000/hops.Components
hops = Hops(
    CacheResultsInMemory=False,
    CacheSolveResults=False,
    RemoteDefinitionLocation="http://localhost:5000/hops.AvailableComponents",
    RemoteSolveVersion=(0, 1, 0),
    ShowInput_Enabled=False,
    ShowInput_Path=False,
    SynchronousSolve=True)  # -> Components, Description
panel_3 = Panel(hops.Components)
panel_4 = Panel(hops.Description)

# ----
# http://localhost:5000/opencv.DetectContours
image_resource = ImageResource("C:\Users\EFESTWIN\source\repos\malt\src\malt\imgprocessing\demo_image.jpg")
hops_2 = Hops(
    FilePath=image_resource,
    BinaryThreshold=Slider(143, range=0..255),
    AreaThreshold=Slider(3758, range=0..6000),
    CacheResultsInMemory=False,
    CacheSolveResults=False,
    RemoteDefinitionLocation="http://localhost:5000/opencv.DetectContours",
    RemoteSolveVersion=(0, 1, 0),
    ShowInput_Enabled=False,
    ShowInput_Path=False,
    SynchronousSolve=False)

# ----
# http://localhost:5000/sklearn.TSNE
# http://localhost:5000/sklearn.TSNE
number_slider = Slider(100, range=-100..100)
dom = ConstructDomain(DomainStart=Slider(-100, range=-100..100), DomainEnd=number_slider)
random = Random(Range=dom, Number=Slider(1000, range=0..1000), Seed=2)
partition = PartitionList(List=random, Size=Slider(20, range=0..100))
hops_3 = Hops(
    Data=partition,
    Components=2,
    CacheResultsInMemory=False,
    CacheSolveResults=False,
    RemoteDefinitionLocation="http://localhost:5000/sklearn.PCA",
    RemoteSolveVersion=(0, 1, 0),
    ShowInput_Enabled=False,
    ShowInput_Path=False,
    SynchronousSolve=True)
hops_4 = Hops(
    Data=partition,
    Components=2,
    Perplexity=30,
    EarlyExaggeration=12,
    LearningRate=200,
    Iterations=1000,
    Method=0,
    RandomSeed=0,
    CacheResultsInMemory=False,
    CacheSolveResults=False,
    RemoteDefinitionLocation="http://localhost:5000/sklearn.TSNE",
    RemoteSolveVersion=(0, 1, 0),
    ShowInput_Enabled=False,
    ShowInput_Path=False,
    SynchronousSolve=True)

translationdistance = Slider(6, range=0..100)
rotationangle = Slider(30, range=0..360)

# ----
# Right click > Set local image to view this demo (does not work with internalized data...)
number_slider_2 = Slider(50, range=1..100)
smoothpline = SmoothPolyline(Polyline=hops_2, Strength=1, Times=number_slider_2)
scale = Scale(Geometry=smoothpline, Center=Point(0, 0, 0), Factor=Slider(0.01, range=0.01..1))  # -> Geometry, Transform
preview = CustomPreview(Geometry=scale.Geometry, Material=ColourSwatch(SwatchColor=RGB(0, 0, 0)))

number_slider_3 = Slider(0, range=0..50)

# ----
# Reconstruct Transformation Matrix from Hops Output (Rhino.transform can't be output through Hops yet...)
index = Slider(9, range=0..20)
X = UnitX(Factor="6")
demorock = Mesh(internalizeddemorock)
multiplication = Multiplication(A=X, B=index)
move = Move(Geometry=demorock, Motion=multiplication)  # -> Geometry, Transform
wbsplitquads = WeaverbirdsConstantQuadsSplitSubdivision(MeshCurves=move.Geometry, Level=1, SmoothNakedEdges=1)
demesh = DeconstructMesh(Mesh=wbsplitquads)  # -> Vertices, Faces, Colours, Normals
wbmeshvertices = Point(demesh.Vertices)
Y = UnitY(Factor=translationdistance)
avr = Average(Input=wbmeshvertices)
demomesh = Mesh(move.Geometry)
wbmesh = Mesh(wbsplitquads)
rotationaxist = Vector(Vector(-0.4156669971, -0.6517605954, -0.6343729769))
move_2 = Move(Geometry=demomesh, Motion=Y)  # -> Geometry, Transform
move_3 = Move(Geometry=wbmesh, Motion=Y)  # -> Geometry, Transform
move_4 = Move(Geometry=avr, Motion=Y)  # -> Geometry, Transform
rot3d = Rotate3D(Geometry=move_3.Geometry, Angle=degrees(rotationangle), Center=move_4.Geometry, Axis=rotationaxist)  # -> Geometry, Transform
rot3d_2 = Rotate3D(Geometry=move_2.Geometry, Angle=degrees(rotationangle), Center=move_4.Geometry, Axis=rotationaxist)  # -> Geometry, Transform
select_scene_points = ValueList({"Identical n. of Points": 0, "Less n. Points": 1}, selected="Less n. Points")
demomeshtransrot = Mesh(rot3d_2.Geometry)
wbmeshtransrot = Mesh(rot3d.Geometry)
filter = StreamFilter(Gate=select_scene_points, Stream0=wbmeshtransrot, Stream1=demomeshtransrot)
demesh_2 = DeconstructMesh(Mesh=filter)  # -> Vertices, Faces, Colours, Normals
demomesh_2 = Mesh(move.Geometry)
preview_2 = CustomPreview(Geometry=filter, Material=ColourSwatch(SwatchColor=RGB(58, 142, 252)))
preview_3 = CustomPreview(Geometry=demomesh_2, Material=ColourSwatch(SwatchColor=RGB(101, 255, 255)))

# ----
# http://localhost:5000/icp.RegisterPointClouds
nearest_neighnor_algorithm = ValueList({"KNN": 0, "Hungarian": 1}, selected="KNN")
modelpoints = Point(wbmeshvertices)
scenepoints = Point(demesh_2.Vertices)
hops_5 = Hops(
    ScenePoints=scenepoints,
    ModelPoints=modelpoints,
    Threshold="1e-3",
    MaxIterations=Slider(30, range=0..100),
    NNAlgorithm=nearest_neighnor_algorithm,
    CacheResultsInMemory=False,
    CacheSolveResults=False,
    RemoteDefinitionLocation="http://localhost:5000/icp.RegisterPointClouds",
    RemoteSolveVersion=(0, 1, 0),
    ShowInput_Enabled=False,
    ShowInput_Path=False,
    SynchronousSolve=False)  # -> RegisteredPoints, Transform, Error, Iterations

matrix = ConstructMatrix(Rows=4, Columns=4, Values=hops_5.Transform)
mean_error = Panel(hops_5.Error)
iterations_before_termination = Panel(hops_5.Iterations)
registeredpoints = Point(hops_5.RegisteredPoints)
matrix_2 = TransformMatrix(matrix, Digits=3)
preview_4 = CustomPreview(Geometry=registeredpoints, Material=ColourSwatch(SwatchColor=RGB(255, 0, 255)))

index_2 = Slider(1, range=0..20)
X_2 = UnitX(Factor="6")
demorock_2 = Mesh(internalizeddemorock)
multiplication_2 = Multiplication(A=X_2, B=index_2)
move_5 = Move(Geometry=demorock_2, Motion=multiplication_2)  # -> Geometry, Transform
popgeo = PopulateGeometry(Geometry=move_5.Geometry, Count=Slider(2000, range=0..10000), Seed=1)

panel_5 = Panel("http://localhost:5000/open3d.AlphaShape")
hops_6 = Hops(
    Points=popgeo,
    Alpha=Slider(1, range=0..5),
    CacheResultsInMemory=False,
    CacheSolveResults=False,
    RemoteDefinitionLocation="http://localhost:5000/open3d.AlphaShape",
    RemoteSolveVersion=(0, 1, 0),
    ShowInput_Enabled=False,
    ShowInput_Path=False,
    SynchronousSolve=False)

preview_5 = CustomPreview(Geometry=hops_6, Material=ColourSwatch(SwatchColor=RGB(159, 224, 227)))

index_3 = Slider(5, range=0..20)
demorock_3 = Mesh(internalizeddemorock)
X_3 = UnitX(Factor="6")
multiplication_3 = Multiplication(A=X_3, B=index_3)
move_6 = Move(Geometry=demorock_3, Motion=multiplication_3)  # -> Geometry, Transform
popgeo_2 = PopulateGeometry(Geometry=move_6.Geometry, Count=Slider(2000, range=0..10000), Seed=1)
meshcp = MeshClosestPoint(Point=popgeo_2, Mesh=move_6.Geometry)  # -> Point, Index, Parameter
meval = MeshEval(Mesh=move_6.Geometry, Parameter=meshcp.Parameter)  # -> Point, Normal, Colour

panel_6 = Panel("http://localhost:5000/open3d.PoissonMeshNormals")
hops_7 = Hops(
    Points=meval.Point,
    Normals=meval.Normal,
    Depth=8,
    Width=0,
    Scale=1.1,
    LinearFit=False,
    CacheResultsInMemory=False,
    CacheSolveResults=False,
    RemoteDefinitionLocation="http://localhost:5000/open3d.PoissonMeshNormals",
    RemoteSolveVersion=(0, 1, 0),
    ShowInput_Enabled=False,
    ShowInput_Path=False,
    SynchronousSolve=False)

preview_6 = CustomPreview(Geometry=hops_7, Material=ColourSwatch(SwatchColor=RGB(159, 224, 227)))

index_4 = Slider(4, range=0..20)
X_4 = UnitX(Factor="6")
demorock_4 = Mesh(internalizeddemorock)
multiplication_4 = Multiplication(A=X_4, B=index_4)
move_7 = Move(Geometry=demorock_4, Motion=multiplication_4)  # -> Geometry, Transform
demesh_3 = DeconstructMesh(Mesh=move_7.Geometry)  # -> Vertices, Faces, Colours, Normals

panel_7 = Panel("http://localhost:5000/open3d.PoissonMesh")
hops_8 = Hops(
    Points=demesh_3.Vertices,
    Depth=8,
    Width=0,
    Scale=1.1,
    LinearFit=False,
    CacheResultsInMemory=False,
    CacheSolveResults=False,
    RemoteDefinitionLocation="http://localhost:5000/open3d.PoissonMesh",
    RemoteSolveVersion=(0, 1, 0),
    ShowInput_Enabled=False,
    ShowInput_Path=False,
    SynchronousSolve=False)

preview_7 = CustomPreview(Geometry=hops_8, Material=ColourSwatch(SwatchColor=RGB(159, 224, 227)))

index_5 = Slider(3, range=0..20)
demorock_5 = Mesh(internalizeddemorock)
X_5 = UnitX(Factor="6")
multiplication_5 = Multiplication(A=X_5, B=index_5)
move_8 = Move(Geometry=demorock_5, Motion=multiplication_5)  # -> Geometry, Transform
popgeo_3 = PopulateGeometry(Geometry=move_8.Geometry, Count=Slider(2000, range=0..10000), Seed=1)
meshcp_2 = MeshClosestPoint(Point=popgeo_3, Mesh=move_8.Geometry)  # -> Point, Index, Parameter
meval_2 = MeshEval(Mesh=move_8.Geometry, Parameter=meshcp_2.Parameter)  # -> Point, Normal, Colour

panel_8 = Panel("http://localhost:5000/open3d.BallPivotingMeshNormals")
hops_9 = Hops(
    Points=meval_2.Point,
    Normals=meval_2.Normal,
    Triangles=100000,
    CacheResultsInMemory=False,
    CacheSolveResults=False,
    RemoteDefinitionLocation="http://localhost:5000/open3d.BallPivotingMeshNormals",
    RemoteSolveVersion=(0, 1, 0),
    ShowInput_Enabled=False,
    ShowInput_Path=False,
    SynchronousSolve=False)

preview_8 = CustomPreview(Geometry=hops_9, Material=ColourSwatch(SwatchColor=RGB(159, 224, 227)))

index_6 = Slider(6, range=0..20)
X_6 = UnitX(Factor="6")
demorock_6 = Mesh(internalizeddemorock)
multiplication_6 = Multiplication(A=X_6, B=index_6)
move_9 = Move(Geometry=demorock_6, Motion=multiplication_6)  # -> Geometry, Transform
wbsplitquads_2 = WeaverbirdsConstantQuadsSplitSubdivision(MeshCurves=move_9.Geometry, Level=2, SmoothNakedEdges=1)
tri = Triangulate(Mesh=wbsplitquads_2)  # -> Mesh, Count

# ----
# http://localhost:5000/intri.IntrinsicTriangulation
hops_10 = Hops(
    Mesh=tri.Mesh,
    CacheResultsInMemory=False,
    CacheSolveResults=False,
    RemoteDefinitionLocation="http://localhost:5000/intri.IntrinsicTriangulation",
    RemoteSolveVersion=(0, 1, 0),
    ShowInput_Enabled=False,
    ShowInput_Path=False,
    SynchronousSolve=False)

demorock_intrinsic = Mesh(hops_10)
preview_9 = CustomPreview(Geometry=demorock_intrinsic, Material=ColourSwatch(SwatchColor=RGB(159, 224, 227)))

index_7 = Slider(2, range=0..20)
X_7 = UnitX(Factor="6")
demorock_7 = Mesh(internalizeddemorock)
multiplication_7 = Multiplication(A=X_7, B=index_7)
move_10 = Move(Geometry=demorock_7, Motion=multiplication_7)  # -> Geometry, Transform
popgeo_4 = PopulateGeometry(Geometry=move_10.Geometry, Count=Slider(2000, range=0..10000), Seed=1)

panel_9 = Panel("http://localhost:5000/open3d.BallPivotingMesh")
hops_11 = Hops(
    Points=popgeo_4,
    Depth=100000,
    CacheResultsInMemory=False,
    CacheSolveResults=False,
    RemoteDefinitionLocation="http://localhost:5000/open3d.BallPivotingMesh",
    RemoteSolveVersion=(0, 1, 0),
    ShowInput_Enabled=False,
    ShowInput_Path=False,
    SynchronousSolve=False)

preview_10 = CustomPreview(Geometry=hops_11, Material=ColourSwatch(SwatchColor=RGB(159, 224, 227)))

demorock_8 = Mesh(internalizeddemorock)
X_8 = UnitX(Factor="0")
move_11 = Move(Geometry=demorock_8, Motion=X_8)  # -> Geometry, Transform
demesh_4 = DeconstructMesh(Mesh=move_11.Geometry)  # -> Vertices, Faces, Colours, Normals

panel_10 = Panel("http://localhost:5000/open3d.ConvexHull")
hops_12 = Hops(
    Points=demesh_4.Vertices,
    CacheResultsInMemory=False,
    CacheSolveResults=False,
    RemoteDefinitionLocation="http://localhost:5000/open3d.ConvexHull",
    RemoteSolveVersion=(0, 1, 0),
    ShowInput_Enabled=False,
    ShowInput_Path=False,
    SynchronousSolve=False)

preview_11 = CustomPreview(Geometry=hops_12, Material=ColourSwatch(SwatchColor=RGB(159, 224, 227)))

demorock_intrinsic_2 = Mesh(demorock_intrinsic)
X_9 = UnitX(Factor="6")
move_12 = Move(Geometry=demorock_intrinsic_2, Motion=X_9)  # -> Geometry, Transform
demesh_5 = DeconstructMesh(Mesh=move_12.Geometry)  # -> Vertices, Faces, Colours, Normals

# ----
# http://localhost:5000/intri.HeatMethodDistance
number_slider_4 = Slider(120, range=0..1000)
hops_13 = Hops(
    Mesh=move_12.Geometry,
    SourceVertex=number_slider_4,
    TextureScale=1,
    CacheResultsInMemory=False,
    CacheSolveResults=False,
    RemoteDefinitionLocation="http://localhost:5000/intri.HeatMethodDistance",
    RemoteSolveVersion=(0, 1, 0),
    ShowInput_Enabled=False,
    ShowInput_Path=False,
    SynchronousSolve=True)  # -> Mesh, Distances, Values

heatvalues = Number(hops_13.Values)
gradient = Gradient(
    LowerLimit=1,
    UpperLimit=0,
    Parameter=heatvalues,
    stops=[0: RGB(243, 57, 0), 0.1: RGB(236, 27, 60), 0.2: RGB(210, 0, 118), 0.3: RGB(103, 0, 120), 0.4: RGB(39, 72, 161), 0.5: RGB(1, 192, 229), 0.6: RGB(18, 178, 90), 0.7: RGB(79, 186, 8), 0.8: RGB(220, 237, 32), 0.9: RGB(247, 159, 20), 1: RGB(243, 57, 0)])
conmesh = ConstructMesh(Vertices=demesh_5.Vertices, Faces=demesh_5.Faces, Colours=gradient)
item = ListItem(List=demesh_5.Vertices, Index=number_slider_4, Wrap=True)
dots = DotDisplay(Point=item, Colour=RGB(0, 0, 0), Size=0.1)
preview_12 = CustomPreview(
    Geometry=conmesh,
    Material={diffuse=RGB(221, 160, 221), emission=RGB(66, 48, 66), shine=0.5, specular=RGB(255, 255, 255), transparency=0})

demorock_intrinsic_3 = Mesh(conmesh)
X_10 = UnitX(Factor="6")
move_13 = Move(Geometry=demorock_intrinsic_3, Motion=X_10)  # -> Geometry, Transform
preview_13 = CustomPreview(
    Geometry=move_13.Geometry,
    Material={diffuse=RGB(221, 160, 221), emission=RGB(66, 48, 66), shine=0.5, specular=RGB(255, 255, 255), transparency=0})

# ----
# http://localhost:5000/igl.MeshIsocurves
number_slider_5 = Slider(25, range=0..100)
heatvalues_2 = Number(heatvalues)
hops_14 = Hops(
    Mesh=move_13.Geometry,
    Values=heatvalues_2,
    Count=number_slider_5,
    CacheResultsInMemory=False,
    CacheSolveResults=False,
    RemoteDefinitionLocation="http://localhost:5000/igl.MeshIsocurves",
    RemoteSolveVersion=(0, 1, 0),
    ShowInput_Enabled=False,
    ShowInput_Path=False,
    SynchronousSolve=False)  # -> VertexPositions, EdgePositions

partition_2 = PartitionList(List=hops_14.EdgePositions, Size="2")  # -> simplify(Chunks)
item_2 = ListItem(List=hops_14.VertexPositions, Index=partition_2, Wrap=True)
item_3 = ListItem(List=item_2, Index=0, Wrap=True)  # -> Item, Item1
ln = Line(StartPoint=item_3.Item, EndPoint=item_3.Item1)
join = JoinCurves(Curves=flatten(ln), Preserve=False)
preview_14 = CustomPreview(Geometry=join, Material=ColourSwatch(SwatchColor=RGB(255, 255, 255)))
