# Grasshopper definition 210819_HopsLauncher_GrasshopperDevelopment.gh (Grasshopper 1.0.7)
# plug-ins: Weaverbird, Hops

internalizeddemomesh = Mesh(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)

translationdistance = Slider(6, range=0..100)
rotationangle = Slider(279, range=0..360)

# ----
# http://localhost:5000/icp.RegisterPointClouds
# Reconstruct Transformation Matrix from Hops Output (Rhino.transform can't be output through Hops yet...)
demomesh = Mesh(internalizeddemomesh)
X = UnitX(Factor="6")  # -> expr("x*3", UnitVector)
move = Move(Geometry=demomesh, Motion=X)  # -> Geometry, Transform
wbsplitquads = WeaverbirdsConstantQuadsSplitSubdivision(MeshCurves=move.Geometry, Level=1, SmoothNakedEdges=1)
demesh = DeconstructMesh(Mesh=wbsplitquads)  # -> Vertices, Faces, Colours, Normals
wbmeshvertices = Point(demesh.Vertices)
Y = UnitY(Factor=translationdistance)
demomesh_2 = Mesh(move.Geometry)
avr = Average(Input=wbmeshvertices)
wbmesh = Mesh(wbsplitquads)
rotationaxist = Vector(Vector(-0.4156669971, -0.6517605954, -0.6343729769))
move_2 = Move(Geometry=demomesh_2, Motion=Y)  # -> Geometry, Transform
move_3 = Move(Geometry=wbmesh, Motion=Y)  # -> Geometry, Transform
move_4 = Move(Geometry=avr, Motion=Y)  # -> Geometry, Transform
rot3d = Rotate3D(Geometry=move_3.Geometry, Angle=degrees(rotationangle), Center=move_4.Geometry, Axis=rotationaxist)  # -> Geometry, Transform
rot3d_2 = Rotate3D(Geometry=move_2.Geometry, Angle=degrees(rotationangle), Center=move_4.Geometry, Axis=rotationaxist)  # -> Geometry, Transform
select_scene_points = ValueList({"Identical n. of Points": 0, "Less n. Points": 1}, selected="Less n. Points")
demomeshtransrot = Mesh(rot3d_2.Geometry)
wbmeshtransrot = Mesh(rot3d.Geometry)
filter = StreamFilter(Gate=select_scene_points, Stream0=wbmeshtransrot, Stream1=demomeshtransrot)
demesh_2 = DeconstructMesh(Mesh=filter)  # -> Vertices, Faces, Colours, Normals
nearest_neighnor_algorithm = ValueList({"KNN": 0, "Hungarian": 1}, selected="KNN")
modelpoints = Point(wbmeshvertices)
scenepoints = Point(demesh_2.Vertices)
hops = Hops(
    ScenePoints=scenepoints,
    ModelPoints=modelpoints,
    Threshold="1e-3",
    MaxIterations=Slider(20, range=0..100),
    NNAlgorithm=nearest_neighnor_algorithm,
    CacheResultsInMemory=False,
    CacheSolveResults=False,
    RemoteDefinitionLocation="http://localhost:5000/icp.RegisterPointClouds",
    RemoteSolveVersion=(0, 1, 0),
    ShowInput_Enabled=False,
    ShowInput_Path=False,
    SynchronousSolve=False)  # -> RegisteredPoints, Transform, Error, Iterations
matrix = ConstructMatrix(Rows=4, Columns=4, Values=hops.Transform)
mean_error = Panel(hops.Error)
iterations_before_termination = Panel(hops.Iterations)
registeredpoints = Point(hops.RegisteredPoints)
demomesh_3 = Mesh(move.Geometry)
matrix_2 = TransformMatrix(matrix, Digits=3)
preview = CustomPreview(Geometry=filter, Material=ColourSwatch(SwatchColor=RGB(58, 142, 252)))
preview_2 = CustomPreview(Geometry=demomesh_3, Material=ColourSwatch(SwatchColor=RGB(101, 255, 255)))
preview_3 = CustomPreview(Geometry=registeredpoints, Material=ColourSwatch(SwatchColor=RGB(255, 0, 255)))

demomesh_4 = Mesh(internalizeddemomesh)
X_2 = UnitX(Factor="0")
move_5 = Move(Geometry=demomesh_4, Motion=X_2)  # -> Geometry, Transform
popgeo = PopulateGeometry(Geometry=move_5.Geometry, Count=Slider(2000, range=0..10000), Seed=1)
meshcp = MeshClosestPoint(Point=popgeo, Mesh=move_5.Geometry)  # -> Point, Index, Parameter
meval = MeshEval(Mesh=move_5.Geometry, Parameter=meshcp.Parameter)  # -> Point, Normal, Colour
panel = Panel("http://localhost:5000/open3d.PoissonMeshNormals")
hops_2 = Hops(
    Points=meval.Point,
    Normals=meval.Normal,
    CacheResultsInMemory=False,
    CacheSolveResults=False,
    RemoteDefinitionLocation="http://localhost:5000/open3d.PoissonMeshNormals",
    RemoteSolveVersion=(0, 1, 0),
    ShowInput_Enabled=False,
    ShowInput_Path=False,
    SynchronousSolve=False)
preview_4 = CustomPreview(Geometry=hops_2, Material=ColourSwatch(SwatchColor=RGB(159, 224, 227)))

# ----
# http://localhost:5000/intri.IntrinsicTriangulation
demomesh_5 = Mesh(internalizeddemomesh)
X_3 = UnitX(Factor="6")  # -> expr("x*2", UnitVector)
move_6 = Move(Geometry=demomesh_5, Motion=X_3)  # -> Geometry, Transform
wbsplitquads_2 = WeaverbirdsConstantQuadsSplitSubdivision(MeshCurves=move_6.Geometry, Level=2, SmoothNakedEdges=1)
tri = Triangulate(Mesh=wbsplitquads_2)  # -> Mesh, Count
hops_3 = Hops(
    Mesh=tri.Mesh,
    CacheResultsInMemory=False,
    CacheSolveResults=False,
    RemoteDefinitionLocation="http://localhost:5000/intri.IntrinsicTriangulation",
    RemoteSolveVersion=(0, 1, 0),
    ShowInput_Enabled=False,
    ShowInput_Path=False,
    SynchronousSolve=False)
preview_5 = CustomPreview(Geometry=hops_3, Material=ColourSwatch(SwatchColor=RGB(159, 224, 227)))

demomesh_6 = Mesh(internalizeddemomesh)
X_4 = UnitX(Factor="6")
panel_2 = Panel("http://localhost:5000/open3d.PoissonMesh")

move_7 = Move(Geometry=demomesh_6, Motion=X_4)  # -> Geometry, Transform

demesh_3 = DeconstructMesh(Mesh=move_7.Geometry)  # -> Vertices, Faces, Colours, Normals
hops_4 = Hops(
    Points=demesh_3.Vertices,
    CacheResultsInMemory=False,
    CacheSolveResults=False,
    RemoteDefinitionLocation="http://localhost:5000/open3d.PoissonMesh",
    RemoteSolveVersion=(0, 1, 0),
    ShowInput_Enabled=False,
    ShowInput_Path=False,
    SynchronousSolve=False)
preview_6 = CustomPreview(Geometry=hops_4, Material=ColourSwatch(SwatchColor=RGB(159, 224, 227)))
