# Grasshopper definition 210914_MALT_GrasshopperDevelopment.gh (Grasshopper 1.0.7)
# plug-ins: Weaverbird, Hops

python = GhPythonScript(Server="localhost:5000", UpdateServer=Toggle(False))  # -> Results; inputs UpdateServer: Boolean
# ---------- python: Python ----------
"""
Updates the server of all Hops Components on the canvas.
    Inputs:
        Server: The ip / address of the server, including the port.
        UpdateServer: Set to True to update all Hops Components on the canvas.
    Output:
        Results: A textual description on which Hops Components have been
                 updated
"""

import Grasshopper as gh
ghdoc = ghenv.Component.OnPingDocument()

error = gh.Kernel.GH_RuntimeMessageLevel.Error
warning = gh.Kernel.GH_RuntimeMessageLevel.Warning
remark = gh.Kernel.GH_RuntimeMessageLevel.Remark

Results = []
if Server and UpdateServer:
    
    # sanitize server string
    if Server.startswith("http://"):
        Server = Server[7:]
    elif Server.startswith("https://"):
        Server = Server[8:]
    
    guids = []
    for obj in ghdoc.Objects:
        if repr(obj).startswith("<Hops.HopsComponent"):
            # get instance guid as string
            ig = str(obj.InstanceGuid)
            # in case there is no remote definition
            if not obj.RemoteDefinitionLocation:
                msg = ("Hops Component with GUID {0} was NOT updated because"
                       "its path is unset!").format(ig)
                obj.AddRuntimeMessage(error, "This " + msg)
                Results.append(msg)
            # if there is a http or https server set
            elif (obj.RemoteDefinitionLocation.startswith("http://") or
                  obj.RemoteDefinitionLocation.startswith("https://")):
                # split the string of the remote location
                parts = obj.RemoteDefinitionLocation.split("/")
                # insert new server into split list
                parts[2] = Server
                newloc = "/".join(parts)
                # set new server location to hops component
                obj.RemoteDefinitionLocation = newloc
                # create message
                msg = ("Hops Component with GUID {0} was updated with new "
                       "server path {1}!").format(ig, Server)
                obj.AddRuntimeMessage(remark, "This " + msg)
                Results.append(msg)
            # in other cases
            else:
                msg = ("Hops Component with GUID {0} was NOT updated because "
                       "its path is not set to a server!").format(ig)
                obj.AddRuntimeMessage(error, "This " + msg)
                Results.append(msg)
# ---------- end python ----------
panel = Panel(python)

internalizedstanfordbunny = Mesh(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)
internalizeddemorock = Mesh(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)
internalizedstanfordbunny_2 = Mesh(internalizedstanfordbunny)

# ----
# List all URI's of the Components available on the Hops Server as well as their descriptions
# http://localhost:5000/hops.Components
hops = Hops(
    CacheResultsInMemory=False,
    CacheSolveResults=False,
    RemoteDefinitionLocation="http://localhost:5000/hops.AvailableComponents",
    RemoteSolveVersion=(0, 1, 0),
    ShowInput_Enabled=False,
    ShowInput_Path=False,
    SynchronousSolve=False)  # -> Components, Description
panel_2 = Panel(hops.Components)
panel_3 = Panel(hops.Description)

demorock = Mesh(internalizeddemorock)
X = UnitX(Factor="7")  # -> expr("x*5", UnitVector)
move = Move(Geometry=demorock, Motion=X)  # -> Geometry, Transform
demesh = DeconstructMesh(Mesh=move.Geometry)  # -> Vertices, Faces, Colours, Normals
panel_4 = Panel("http://localhost:5000/open3d.ConvexHull")
hops_2 = Hops(
    Points=demesh.Vertices,
    CacheResultsInMemory=False,
    CacheSolveResults=False,
    RemoteDefinitionLocation="http://localhost:5000/open3d.ConvexHull",
    RemoteSolveVersion=(0, 1, 0),
    ShowInput_Enabled=False,
    ShowInput_Path=False,
    SynchronousSolve=False)

# ----
# http://localhost:5000/opencv.DetectContours
image_resource = ImageResource("C:\Users\EFESTWIN\source\repos\malt\src\malt\imgprocessing\demo_image.jpg")
hops_3 = Hops(
    FilePath=image_resource,
    BinaryThreshold=Slider(113, range=0..255),
    AreaThreshold=Slider(3758, range=0..6000),
    CacheResultsInMemory=False,
    CacheSolveResults=False,
    RemoteDefinitionLocation="http://localhost:5000/opencv.DetectContours",
    RemoteSolveVersion=(0, 1, 0),
    ShowInput_Enabled=False,
    ShowInput_Path=False,
    SynchronousSolve=False)

translationdistance = Slider(6, range=0..100)
rotationangle = Slider(30, range=0..360)

# ----
# http://localhost:5000/icp.RegisterPointClouds
# Reconstruct Transformation Matrix from Hops Output (Rhino.transform can't be output through Hops yet...)
demorock_2 = Mesh(internalizeddemorock)
X_2 = UnitX(Factor="6")  # -> expr("x*5", UnitVector)
move_2 = Move(Geometry=demorock_2, Motion=X_2)  # -> Geometry, Transform
wbsplitquads = WeaverbirdsConstantQuadsSplitSubdivision(MeshCurves=move_2.Geometry, Level=1, SmoothNakedEdges=1)
demesh_2 = DeconstructMesh(Mesh=wbsplitquads)  # -> Vertices, Faces, Colours, Normals
wbmeshvertices = Point(demesh_2.Vertices)
Y = UnitY(Factor=translationdistance)
avr = Average(Input=wbmeshvertices)
demomesh = Mesh(move_2.Geometry)
wbmesh = Mesh(wbsplitquads)
rotationaxist = Vector(Vector(-0.4156669971, -0.6517605954, -0.6343729769))
move_3 = Move(Geometry=demomesh, Motion=Y)  # -> Geometry, Transform
move_4 = Move(Geometry=wbmesh, Motion=Y)  # -> Geometry, Transform
move_5 = Move(Geometry=avr, Motion=Y)  # -> Geometry, Transform
rot3d = Rotate3D(Geometry=move_4.Geometry, Angle=degrees(rotationangle), Center=move_5.Geometry, Axis=rotationaxist)  # -> Geometry, Transform
rot3d_2 = Rotate3D(Geometry=move_3.Geometry, Angle=degrees(rotationangle), Center=move_5.Geometry, Axis=rotationaxist)  # -> Geometry, Transform
select_scene_points = ValueList({"Identical n. of Points": 0, "Less n. Points": 1}, selected="Less n. Points")
demomeshtransrot = Mesh(rot3d_2.Geometry)
wbmeshtransrot = Mesh(rot3d.Geometry)
filter = StreamFilter(Gate=select_scene_points, Stream0=wbmeshtransrot, Stream1=demomeshtransrot)
demesh_3 = DeconstructMesh(Mesh=filter)  # -> Vertices, Faces, Colours, Normals
nearest_neighnor_algorithm = ValueList({"KNN": 0, "Hungarian": 1}, selected="KNN")
modelpoints = Point(wbmeshvertices)
scenepoints = Point(demesh_3.Vertices)
hops_4 = Hops(
    ScenePoints=scenepoints,
    ModelPoints=modelpoints,
    Threshold="1e-3",
    MaxIterations=Slider(30, range=0..100),
    NNAlgorithm=nearest_neighnor_algorithm,
    CacheResultsInMemory=False,
    CacheSolveResults=False,
    RemoteDefinitionLocation="http://localhost:5000/icp.RegisterPointClouds",
    RemoteSolveVersion=(0, 1, 0),
    ShowInput_Enabled=False,
    ShowInput_Path=False,
    SynchronousSolve=False)  # -> RegisteredPoints, Transform, Error, Iterations
matrix = ConstructMatrix(Rows=4, Columns=4, Values=hops_4.Transform)
mean_error = Panel(hops_4.Error)
iterations_before_termination = Panel(hops_4.Iterations)
registeredpoints = Point(hops_4.RegisteredPoints)
demomesh_2 = Mesh(move_2.Geometry)
matrix_2 = TransformMatrix(matrix, Digits=3)
preview = CustomPreview(Geometry=filter, Material=ColourSwatch(SwatchColor=RGB(58, 142, 252)))
preview_2 = CustomPreview(Geometry=demomesh_2, Material=ColourSwatch(SwatchColor=RGB(101, 255, 255)))
preview_3 = CustomPreview(Geometry=registeredpoints, Material=ColourSwatch(SwatchColor=RGB(255, 0, 255)))

# ----
# Right click > Set local image to view this demo (does not work with internalized data...)
number_slider = Slider(50, range=1..100)
smoothpline = SmoothPolyline(Polyline=hops_3, Strength=1, Times=number_slider)
scale = Scale(Geometry=smoothpline, Center=Point(0, 0, 0), Factor=Slider(0.01, range=0.01..1))  # -> Geometry, Transform
preview_4 = CustomPreview(Geometry=scale.Geometry, Material=ColourSwatch(SwatchColor=RGB(0, 0, 0)))

demorock_3 = Mesh(internalizeddemorock)
X_3 = UnitX(Factor="0")
move_6 = Move(Geometry=demorock_3, Motion=X_3)  # -> Geometry, Transform
popgeo = PopulateGeometry(Geometry=move_6.Geometry, Count=Slider(2000, range=0..10000), Seed=1)
meshcp = MeshClosestPoint(Point=popgeo, Mesh=move_6.Geometry)  # -> Point, Index, Parameter
meval = MeshEval(Mesh=move_6.Geometry, Parameter=meshcp.Parameter)  # -> Point, Normal, Colour

panel_5 = Panel("http://localhost:5000/open3d.PoissonMeshNormals")
hops_5 = Hops(
    Points=meval.Point,
    Normals=meval.Normal,
    Depth=8,
    Width=0,
    Scale=1.1,
    LinearFit=False,
    CacheResultsInMemory=False,
    CacheSolveResults=False,
    RemoteDefinitionLocation="http://localhost:5000/open3d.PoissonMeshNormals",
    RemoteSolveVersion=(0, 1, 0),
    ShowInput_Enabled=False,
    ShowInput_Path=False,
    SynchronousSolve=False)

preview_5 = CustomPreview(Geometry=hops_5, Material=ColourSwatch(SwatchColor=RGB(159, 224, 227)))

demorock_4 = Mesh(internalizeddemorock)
X_4 = UnitX(Factor="6")  # -> expr("x*2", UnitVector)
move_7 = Move(Geometry=demorock_4, Motion=X_4)  # -> Geometry, Transform
wbsplitquads_2 = WeaverbirdsConstantQuadsSplitSubdivision(MeshCurves=move_7.Geometry, Level=2, SmoothNakedEdges=1)
tri = Triangulate(Mesh=wbsplitquads_2)  # -> Mesh, Count

# ----
# http://localhost:5000/intri.IntrinsicTriangulation
hops_6 = Hops(
    Mesh=tri.Mesh,
    CacheResultsInMemory=False,
    CacheSolveResults=False,
    RemoteDefinitionLocation="http://localhost:5000/intri.IntrinsicTriangulation",
    RemoteSolveVersion=(0, 1, 0),
    ShowInput_Enabled=False,
    ShowInput_Path=False,
    SynchronousSolve=False)

demorock_intrinsic = Mesh(hops_6)
preview_6 = CustomPreview(Geometry=demorock_intrinsic, Material=ColourSwatch(SwatchColor=RGB(159, 224, 227)))

demorock_5 = Mesh(internalizeddemorock)
X_5 = UnitX(Factor="6")
move_8 = Move(Geometry=demorock_5, Motion=X_5)  # -> Geometry, Transform
demesh_4 = DeconstructMesh(Mesh=move_8.Geometry)  # -> Vertices, Faces, Colours, Normals

panel_6 = Panel("http://localhost:5000/open3d.PoissonMesh")
hops_7 = Hops(
    Points=demesh_4.Vertices,
    Depth=8,
    Width=0,
    Scale=1.1,
    LinearFit=False,
    CacheResultsInMemory=False,
    CacheSolveResults=False,
    RemoteDefinitionLocation="http://localhost:5000/open3d.PoissonMesh",
    RemoteSolveVersion=(0, 1, 0),
    ShowInput_Enabled=False,
    ShowInput_Path=False,
    SynchronousSolve=False)

preview_7 = CustomPreview(Geometry=hops_7, Material=ColourSwatch(SwatchColor=RGB(159, 224, 227)))

demorock_intrinsic_2 = Mesh(demorock_intrinsic)
X_6 = UnitX(Factor="6")
move_9 = Move(Geometry=demorock_intrinsic_2, Motion=X_6)  # -> Geometry, Transform
demesh_5 = DeconstructMesh(Mesh=move_9.Geometry)  # -> Vertices, Faces, Colours, Normals

# ----
# http://localhost:5000/intri.HeatMethodDistance
number_slider_2 = Slider(120, range=0..1000)
hops_8 = Hops(
    Mesh=move_9.Geometry,
    SourceVertex=number_slider_2,
    TextureScale=1,
    CacheResultsInMemory=False,
    CacheSolveResults=False,
    RemoteDefinitionLocation="http://localhost:5000/intri.HeatMethodDistance",
    RemoteSolveVersion=(0, 1, 0),
    ShowInput_Enabled=False,
    ShowInput_Path=False,
    SynchronousSolve=False)  # -> Mesh, Distances, Values

heatvalues = Number(hops_8.Values)
gradient = Gradient(
    LowerLimit=1,
    UpperLimit=0,
    Parameter=heatvalues,
    stops=[0: RGB(243, 57, 0), 0.1: RGB(236, 27, 60), 0.2: RGB(210, 0, 118), 0.3: RGB(103, 0, 120), 0.4: RGB(39, 72, 161), 0.5: RGB(1, 192, 229), 0.6: RGB(18, 178, 90), 0.7: RGB(79, 186, 8), 0.8: RGB(220, 237, 32), 0.9: RGB(247, 159, 20), 1: RGB(243, 57, 0)])
conmesh = ConstructMesh(Vertices=demesh_5.Vertices, Faces=demesh_5.Faces, Colours=gradient)
item = ListItem(List=demesh_5.Vertices, Index=number_slider_2, Wrap=True)
dots = DotDisplay(Point=item, Colour=RGB(0, 0, 0), Size=0.1)
preview_8 = CustomPreview(
    Geometry=conmesh,
    Material={diffuse=RGB(221, 160, 221), emission=RGB(66, 48, 66), shine=0.5, specular=RGB(255, 255, 255), transparency=0})

demorock_intrinsic_3 = Mesh(conmesh)
X_7 = UnitX(Factor="6")
move_10 = Move(Geometry=demorock_intrinsic_3, Motion=X_7)  # -> Geometry, Transform
preview_9 = CustomPreview(
    Geometry=move_10.Geometry,
    Material={diffuse=RGB(221, 160, 221), emission=RGB(66, 48, 66), shine=0.5, specular=RGB(255, 255, 255), transparency=0})

# ----
# http://localhost:5000/igl.MeshIsocurves
number_slider_3 = Slider(25, range=0..100)
heatvalues_2 = Number(heatvalues)
hops_9 = Hops(
    Mesh=move_10.Geometry,
    Values=heatvalues_2,
    Count=number_slider_3,
    CacheResultsInMemory=False,
    CacheSolveResults=False,
    RemoteDefinitionLocation="http://localhost:5000/igl.MeshIsocurves",
    RemoteSolveVersion=(0, 1, 0),
    ShowInput_Enabled=False,
    ShowInput_Path=False,
    SynchronousSolve=False)  # -> VertexPositions, EdgePositions

partition = PartitionList(List=hops_9.EdgePositions, Size="2")  # -> simplify(Chunks)
item_2 = ListItem(List=hops_9.VertexPositions, Index=partition, Wrap=True)
item_3 = ListItem(List=item_2, Index=0, Wrap=True)  # -> Item, Item1
ln = Line(StartPoint=item_3.Item, EndPoint=item_3.Item1)
join = JoinCurves(Curves=flatten(ln), Preserve=False)
preview_10 = CustomPreview(Geometry=join, Material=ColourSwatch(SwatchColor=RGB(255, 255, 255)))
