# Grasshopper definition 221114_MALT_GrasshopperDevelopment.gh (Grasshopper 1.0.7)
# plug-ins: Weaverbird, Hops

pt = Point(Point(21.47141535, -94.32250164, 0))
pt_2 = Point(Point(57.65486014, -52.60865679, 0))
pt_3 = Point(Point(109.4056228, -52.60865679, 0))
merge = Merge(Data1=graft(pt), Data2=graft([pt_2, pt]), Data3=graft([pt_3, pt_2, pt]))
pt2num = PointsToNumbers(Points=merge, Mask=4)
panel = Panel(pt2num)
hops = Hops(
    _Path="http://localhost:5000/test.DataTree",
    InTree=pt2num,
    CacheResultsInMemory=False,
    CacheSolveResults=False,
    RemoteDefinitionLocation="http://localhost:5000/test.DataTree",
    RemoteSolveVersion=(0, 1, 0),
    ShowInput_Enabled=False,
    ShowInput_Path=True,
    SynchronousSolve=False)
panel_2 = Panel(hops)

# ----
# Attempt to update all Hops components on the canvas with a given server path.
panel_3 = Panel("localhost:5000")
uhsp = UpdateHopsServerPaths(Server=panel_3, Update=Toggle(False))  # -> Results; inputs Update: Boolean
# ---------- uhsp: Python ----------
"""
Attempts to update the server path of all Hops Components on the canvas.
    Inputs:
        Server: The ip / address of the server, including the port.
        Update: Set to True to update all Hops Components on the canvas.
    Output:
        Results: A textual description on which Hops Components have been
                 updated
    Remarks:
        Author: Max Eschenbach
        License: MIT License
        Version: 210917
"""

# GHPYTHON SDK IMPORTS
from ghpythonlib.componentbase import executingcomponent as component
import Grasshopper, GhPython
import System
import Rhino
import rhinoscriptsyntax as rs

# GHENV COMPONENT SETTINGS
ghenv.Component.Name = "UpdateHopsServerPaths"
ghenv.Component.NickName = "UHSP"
ghenv.Component.Category = "Malt"
ghenv.Component.SubCategory = "10 Utilities"

class UpdateHopsServerPaths(component):
    
    def RunScript(self, Server, Update):
        
        ghdoc = self.OnPingDocument()
        
        error = self.RuntimeMessageLevel.Error
        warning = self.RuntimeMessageLevel.Warning
        remark = self.RuntimeMessageLevel.Remark
        
        Results = []
        if Server and Update:
            
            # sanitize server string
            if Server.startswith("http://"):
                Server = Server[7:]
            elif Server.startswith("https://"):
                Server = Server[8:]
            
            for obj in ghdoc.Objects:
                if repr(obj).startswith("<Hops.HopsComponent"):
                    # get instance guid as string
                    ig = str(obj.InstanceGuid)
                    # in case there is no remote definition
                    if not obj.RemoteDefinitionLocation:
                        msg = ("Hops Component with GUID {0} was NOT updated because"
                               "its path is unset!").format(ig)
                        obj.AddRuntimeMessage(error, "This " + msg)
                        Results.append(msg)
                    # if there is a http or https server set
                    elif (obj.RemoteDefinitionLocation.startswith("http://") or
                          obj.RemoteDefinitionLocation.startswith("https://")):
                        # split the string of the remote location
                        parts = obj.RemoteDefinitionLocation.split("/")
                        # insert new server into split list
                        parts[2] = Server
                        newloc = "/".join(parts)
                        # set new server location to hops component
                        obj.RemoteDefinitionLocation = newloc
                        # create message
                        msg = ("Hops Component with GUID {0} was updated with new "
                               "server path {1}!").format(ig, Server)
                        obj.AddRuntimeMessage(remark, "This " + msg)
                        Results.append(msg)
                    # in other cases
                    else:
                        msg = ("Hops Component with GUID {0} was NOT updated because "
                               "its path is not set to a server!").format(ig)
                        obj.AddRuntimeMessage(error, "This " + msg)
                        Results.append(msg)
        
        # return outputs if you have them; here I try it for you:
        return Results
# ---------- end uhsp ----------
panel_4 = Panel(uhsp)

pt_4 = Point(Point(21.47141535, -94.32250164, 0))
pt_5 = Point(Point(57.65486014, -52.60865679, 0))
pt_6 = Point(Point(109.4056228, -52.60865679, 0))
panel_5 = Panel([pt_4, pt_5, pt_6])
xy = XYPlane(Origin=pt_4)
xz = XZPlane(Origin=pt_5)
yz = YZPlane(Origin=pt_6)
hops_2 = Hops(
    _Path="http://localhost:5000/test.Plane",
    InPlane=[xy, xz, yz],
    CacheResultsInMemory=False,
    CacheSolveResults=False,
    RemoteDefinitionLocation="http://localhost:5000/test.Plane",
    RemoteSolveVersion=(0, 1, 0),
    ShowInput_Enabled=False,
    ShowInput_Path=True,
    SynchronousSolve=False)
panel_6 = Panel(hops_2)

internalizedstanfordbunny = Mesh(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)
internalizedstanfordbunnyremeshed = Mesh(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)
internalizeddemorock = Mesh(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)
internalizedstanfordbunny_2 = Mesh(internalizedstanfordbunny)

# ----
# List all URI's of the Components available on the Hops Server as well as their descriptions
# http://localhost:5000/hops.Components
hops_3 = Hops(
    CacheResultsInMemory=False,
    CacheSolveResults=False,
    RemoteDefinitionLocation="http://localhost:5000/hops.AvailableComponents",
    RemoteSolveVersion=(0, 1, 0),
    ShowInput_Enabled=False,
    ShowInput_Path=False,
    SynchronousSolve=True)  # -> Components, Description
panel_7 = Panel(hops_3.Components)
panel_8 = Panel(hops_3.Description)

# ----
# http://localhost:5000/opencv.DetectContoursFile
image_resource = ImageResource("C:\Users\EFESTWIN\source\repos\malt\src\malt\imgprocessing\demo_image.jpg")
invert = BooleanToggle(True)

# ----
# http://localhost:5000/sklearn.TSNE
# http://localhost:5000/sklearn.PCA
number_slider = Slider(100, range=-100..100)
dom = ConstructDomain(DomainStart=Slider(-100, range=-100..100), DomainEnd=number_slider)
random = Random(Range=dom, Number=Slider(1000, range=0..1000), Seed=2)
partition = PartitionList(List=random, Size=Slider(20, range=0..100))
hops_4 = Hops(
    Data=partition,
    Components=2,
    Perplexity=30,
    EarlyExaggeration=12,
    LearningRate=200,
    Iterations=1000,
    Method=0,
    Initialization=0,
    RandomSeed=0,
    CacheResultsInMemory=False,
    CacheSolveResults=False,
    RemoteDefinitionLocation="http://localhost:5000/sklearn.TSNE",
    RemoteSolveVersion=(0, 1, 0),
    ShowInput_Enabled=False,
    ShowInput_Path=False,
    SynchronousSolve=True)
hops_5 = Hops(
    Data=partition,
    Components=2,
    CacheResultsInMemory=False,
    CacheSolveResults=False,
    RemoteDefinitionLocation="http://localhost:5000/sklearn.PCA",
    RemoteSolveVersion=(0, 1, 0),
    ShowInput_Enabled=False,
    ShowInput_Path=False,
    SynchronousSolve=True)

matrix = ConstructMatrix(Rows=3, Columns=3)
matrix_2 = TransformMatrix(matrix, Digits=3)
dematrix = DeconstructMatrix(Matrix=matrix)  # -> Rows, Columns, Values
partition_2 = PartitionList(List=dematrix.Values, Size=Slider(3, range=0..10))

translationdistance = Slider(6, range=0..100)
rotationangle = Slider(30, range=0..360)

hops_6 = Hops(
    Run=Toggle(True),
    FilePath=image_resource,
    BinaryThreshold=Slider(135, range=0..255),
    AreaThreshold=Slider(3032, range=0..6000),
    Width=1000,
    Height=1000,
    ChainApproximation=0,
    Invert=invert,
    ExtOnly=True,
    Transform=partition_2,
    CacheResultsInMemory=False,
    CacheSolveResults=False,
    RemoteDefinitionLocation="http://localhost:5000/opencv.DetectContoursFile",
    RemoteSolveVersion=(0, 1, 0),
    ShowInput_Enabled=False,
    ShowInput_Path=False,
    SynchronousSolve=False)  # -> Boundary, Contours

# ----
# Right click > Set local image to view this demo (does not work with internalized data...)
number_slider_2 = Slider(50, range=1..100)
smoothpline = SmoothPolyline(Polyline=hops_6.Contours, Strength=1, Times=number_slider_2)
scale = Scale(Geometry=smoothpline, Center=Point(0, 0, 0), Factor=Slider(0.01, range=0.01..1))  # -> Geometry, Transform
Y = UnitY(Factor=Slider(10, range=0..1000))
move = Move(Geometry=scale.Geometry, Motion=Y)  # -> Geometry, Transform
preview = CustomPreview(Geometry=move.Geometry, Material=ColourSwatch(SwatchColor=RGB(0, 0, 0)))

pt_7 = Point(Point(42.7981384, -94.32250164, 0))
pt_8 = Point(Point(57.65486014, -52.60865679, 0))
pt_9 = Point(Point(109.4056228, -52.60865679, 0))
panel_9 = Panel([pt_7, pt_8, pt_9])
xy_2 = XYPlane(Origin=pt_7)
xz_2 = XZPlane(Origin=pt_8)
yz_2 = YZPlane(Origin=pt_9)
cir = Circle(Plane=[xy_2, xz_2, yz_2], Radius=Slider(10, range=0..10))

hops_7 = Hops(
    _Path="http://localhost:5000/test.Circle",
    InCircle=cir,
    CacheResultsInMemory=False,
    CacheSolveResults=False,
    RemoteDefinitionLocation="http://localhost:5000/test.Circle",
    RemoteSolveVersion=(0, 1, 0),
    ShowInput_Enabled=False,
    ShowInput_Path=True,
    SynchronousSolve=False)

darc = DeconstructArc(Arc=hops_7)  # -> BasePlane, Radius, Angle
panel_10 = Panel(hops_7)
panel_11 = Panel(darc.BasePlane)

# ----
# Reconstruct Transformation Matrix from Hops Output (Rhino.Transform can't be output through Hops yet...)
index = Slider(9, range=0..20)
X = UnitX(Factor="6")
demorock = Mesh(internalizeddemorock)
multiplication = Multiplication(A=X, B=index)
move_2 = Move(Geometry=demorock, Motion=multiplication)  # -> Geometry, Transform
wbsplitquads = WeaverbirdsConstantQuadsSplitSubdivision(MeshCurves=move_2.Geometry, Level=1, SmoothNakedEdges=1)
demesh = DeconstructMesh(Mesh=wbsplitquads)  # -> Vertices, Faces, Colours, Normals
wbmeshvertices = Point(demesh.Vertices)
Y_2 = UnitY(Factor=translationdistance)
avr = Average(Input=wbmeshvertices)
demomesh = Mesh(move_2.Geometry)
wbmesh = Mesh(wbsplitquads)
rotationaxist = Vector(Vector(-0.4156669971, -0.6517605954, -0.6343729769))
move_3 = Move(Geometry=demomesh, Motion=Y_2)  # -> Geometry, Transform
move_4 = Move(Geometry=wbmesh, Motion=Y_2)  # -> Geometry, Transform
move_5 = Move(Geometry=avr, Motion=Y_2)  # -> Geometry, Transform
rot3d = Rotate3D(Geometry=move_4.Geometry, Angle=degrees(rotationangle), Center=move_5.Geometry, Axis=rotationaxist)  # -> Geometry, Transform
rot3d_2 = Rotate3D(Geometry=move_3.Geometry, Angle=degrees(rotationangle), Center=move_5.Geometry, Axis=rotationaxist)  # -> Geometry, Transform
select_scene_points = ValueList({"Identical n. of Points": 0, "Less n. Points": 1}, selected="Less n. Points")
demomeshtransrot = Mesh(rot3d_2.Geometry)
wbmeshtransrot = Mesh(rot3d.Geometry)
filter = StreamFilter(Gate=select_scene_points, Stream0=wbmeshtransrot, Stream1=demomeshtransrot)
demesh_2 = DeconstructMesh(Mesh=filter)  # -> Vertices, Faces, Colours, Normals
demomesh_2 = Mesh(move_2.Geometry)
preview_2 = CustomPreview(Geometry=filter, Material=ColourSwatch(SwatchColor=RGB(58, 142, 252)))
preview_3 = CustomPreview(Geometry=demomesh_2, Material=ColourSwatch(SwatchColor=RGB(101, 255, 255)))

# ----
# http://localhost:5000/icp.RegisterPointClouds
nearest_neighnor_algorithm = ValueList({"KNN": 0, "Hungarian": 1}, selected="KNN")
modelpoints = Point(wbmeshvertices)
scenepoints = Point(demesh_2.Vertices)
hops_8 = Hops(
    ScenePoints=scenepoints,
    ModelPoints=modelpoints,
    Threshold="1e-3",
    MaxIterations=Slider(30, range=0..100),
    NNAlgorithm=nearest_neighnor_algorithm,
    CacheResultsInMemory=False,
    CacheSolveResults=False,
    RemoteDefinitionLocation="http://localhost:5000/icp.RegisterPointClouds",
    RemoteSolveVersion=(0, 1, 0),
    ShowInput_Enabled=False,
    ShowInput_Path=False,
    SynchronousSolve=False)  # -> RegisteredPoints, Transform, Error, Iterations

matrix_3 = ConstructMatrix(Rows=4, Columns=4, Values=hops_8.Transform)
mean_error = Panel(hops_8.Error)
iterations_before_termination = Panel(hops_8.Iterations)
registeredpoints = Point(hops_8.RegisteredPoints)
matrix_4 = TransformMatrix(matrix_3, Digits=3)
preview_4 = CustomPreview(Geometry=registeredpoints, Material=ColourSwatch(SwatchColor=RGB(255, 0, 255)))

index_2 = Slider(1, range=0..20)
X_2 = UnitX(Factor="6")
demorock_2 = Mesh(internalizeddemorock)
multiplication_2 = Multiplication(A=X_2, B=index_2)
move_6 = Move(Geometry=demorock_2, Motion=multiplication_2)  # -> Geometry, Transform
popgeo = PopulateGeometry(Geometry=move_6.Geometry, Count=Slider(2000, range=0..10000), Seed=1)

panel_12 = Panel("http://localhost:5000/open3d.AlphaShape")
hops_9 = Hops(
    Points=popgeo,
    Alpha=Slider(1, range=0..5),
    CacheResultsInMemory=False,
    CacheSolveResults=False,
    RemoteDefinitionLocation="http://localhost:5000/open3d.AlphaShape",
    RemoteSolveVersion=(0, 1, 0),
    ShowInput_Enabled=False,
    ShowInput_Path=False,
    SynchronousSolve=False)

preview_5 = CustomPreview(Geometry=hops_9, Material=ColourSwatch(SwatchColor=RGB(159, 224, 227)))

index_3 = Slider(5, range=0..20)
demorock_3 = Mesh(internalizeddemorock)
X_3 = UnitX(Factor="6")
multiplication_3 = Multiplication(A=X_3, B=index_3)
move_7 = Move(Geometry=demorock_3, Motion=multiplication_3)  # -> Geometry, Transform
popgeo_2 = PopulateGeometry(Geometry=move_7.Geometry, Count=Slider(2000, range=0..10000), Seed=1)
meshcp = MeshClosestPoint(Point=popgeo_2, Mesh=move_7.Geometry)  # -> Point, Index, Parameter
meval = MeshEval(Mesh=move_7.Geometry, Parameter=meshcp.Parameter)  # -> Point, Normal, Colour

panel_13 = Panel("http://localhost:5000/open3d.PoissonMeshNormals")
hops_10 = Hops(
    Points=meval.Point,
    Normals=meval.Normal,
    Depth=8,
    Width=0,
    Scale=1.1,
    LinearFit=False,
    CacheResultsInMemory=False,
    CacheSolveResults=False,
    RemoteDefinitionLocation="http://localhost:5000/open3d.PoissonMeshNormals",
    RemoteSolveVersion=(0, 1, 0),
    ShowInput_Enabled=False,
    ShowInput_Path=False,
    SynchronousSolve=True)

preview_6 = CustomPreview(Geometry=hops_10, Material=ColourSwatch(SwatchColor=RGB(159, 224, 227)))

index_4 = Slider(4, range=0..20)
X_4 = UnitX(Factor="6")
demorock_4 = Mesh(internalizeddemorock)
multiplication_4 = Multiplication(A=X_4, B=index_4)
move_8 = Move(Geometry=demorock_4, Motion=multiplication_4)  # -> Geometry, Transform
demesh_3 = DeconstructMesh(Mesh=move_8.Geometry)  # -> Vertices, Faces, Colours, Normals

panel_14 = Panel("http://localhost:5000/open3d.PoissonMesh")
hops_11 = Hops(
    Points=demesh_3.Vertices,
    Depth=8,
    Width=0,
    Scale=1.1,
    LinearFit=False,
    CacheResultsInMemory=False,
    CacheSolveResults=False,
    RemoteDefinitionLocation="http://localhost:5000/open3d.PoissonMesh",
    RemoteSolveVersion=(0, 1, 0),
    ShowInput_Enabled=False,
    ShowInput_Path=False,
    SynchronousSolve=False)

preview_7 = CustomPreview(Geometry=hops_11, Material=ColourSwatch(SwatchColor=RGB(159, 224, 227)))

internalizedstanfordbunnyremeshed_2 = Mesh(internalizedstanfordbunnyremeshed)
index_5 = Slider(11, range=0..20)
X_5 = UnitX(Factor="6")
multiplication_5 = Multiplication(A=X_5, B=index_5)
move_9 = Move(Geometry=internalizedstanfordbunnyremeshed_2, Motion=multiplication_5)  # -> Geometry, Transform
source_c = Slider(729, range=0..1000)
source_a = Slider(688, range=0..1000)
source_b = Slider(408, range=0..1000)
demesh_4 = DeconstructMesh(Mesh=move_9.Geometry)  # -> Vertices, Faces, Colours, Normals
merge_2 = Merge(Data1=source_a, Data2=source_b, Data3=source_c)
item = ListItem(List=demesh_4.Vertices, Index=merge_2, Wrap=True)
dots = DotDisplay(Point=item, Colour=RGB(0, 0, 0), Size=0.1)

panel_15 = Panel("http://localhost:5000/pp3d.MeshHeatMethodDistance")
hops_12 = Hops(
    Mesh=move_9.Geometry,
    Sources=merge_2,
    TextureScale=1,
    CacheResultsInMemory=False,
    CacheSolveResults=False,
    RemoteDefinitionLocation="http://localhost:5000/pp3d.MeshHeatMethodDistance",
    RemoteSolveVersion=(0, 1, 0),
    ShowInput_Enabled=False,
    ShowInput_Path=False,
    SynchronousSolve=False)  # -> Mesh, Distances, Values

heatvalues = Number(hops_12.Values)
gradient = Gradient(
    LowerLimit=1,
    UpperLimit=0,
    Parameter=heatvalues,
    stops=[0: RGB(243, 57, 0), 0.1: RGB(236, 27, 60), 0.2: RGB(210, 0, 118), 0.3: RGB(103, 0, 120), 0.4: RGB(39, 72, 161), 0.5: RGB(1, 192, 229), 0.6: RGB(18, 178, 90), 0.7: RGB(79, 186, 8), 0.8: RGB(220, 237, 32), 0.9: RGB(247, 159, 20), 1: RGB(243, 57, 0)])
conmesh = ConstructMesh(Vertices=demesh_4.Vertices, Faces=demesh_4.Faces, Colours=gradient)
preview_8 = CustomPreview(
    Geometry=conmesh,
    Material={diffuse=RGB(221, 160, 221), emission=RGB(66, 48, 66), shine=0.5, specular=RGB(255, 255, 255), transparency=0})

internalizedstanfordbunnyremeshed_3 = Mesh(internalizedstanfordbunnyremeshed)
index_6 = Slider(17, range=0..20)
X_6 = UnitX(Factor="6")
multiplication_6 = Multiplication(A=X_6, B=index_6)
move_10 = Move(Geometry=internalizedstanfordbunnyremeshed_3, Motion=multiplication_6)  # -> Geometry, Transform
source_c_2 = Slider(236, range=0..1000)
source_a_2 = Slider(223, range=0..1000)
source_b_2 = Slider(249, range=0..1000)
demesh_5 = DeconstructMesh(Mesh=move_10.Geometry)  # -> Vertices, Faces, Colours, Normals
vec = VectorXYZ(XComponent=Slider(4.1, range=0..5), YComponent=Slider(0.9, range=0..5), ZComponent=0)  # -> Vector, Length
vec_2 = VectorXYZ(XComponent=Slider(2, range=0..6), YComponent=Slider(0.8, range=0..1), ZComponent=0)  # -> Vector, Length
vec_3 = VectorXYZ(XComponent=Slider(0.1, range=0..1), YComponent=Slider(0.9, range=0..1), ZComponent=0)  # -> Vector, Length
merge_3 = Merge(Data1=source_a_2, Data2=source_b_2, Data3=source_c_2)
merge_4 = Merge(Data1=vec_3.Vector, Data2=vec_2.Vector, Data3=vec.Vector)
item_2 = ListItem(List=demesh_5.Vertices, Index=merge_3, Wrap=True)
dots_2 = DotDisplay(Point=item_2, Colour=RGB(0, 0, 0), Size=0.1)

panel_16 = Panel("http://localhost:5000/pp3d.MeshVectorHeatParallelTransport")
hops_13 = Hops(
    Mesh=move_10.Geometry,
    Sources=merge_3,
    Vectors=merge_4,
    CacheResultsInMemory=False,
    CacheSolveResults=False,
    RemoteDefinitionLocation="http://localhost:5000/pp3d.MeshVectorHeatParallelTransport",
    RemoteSolveVersion=(0, 1, 0),
    ShowInput_Enabled=False,
    ShowInput_Path=False,
    SynchronousSolve=False)  # -> TangentFrames, TransportVectors, MappedVectors

lng = ListLength(List=hops_13.MappedVectors)
wheel = ColourWheel(
    lng,
    ColourGrips_Style=10,
    ColourGrips_Grip=[5.375470277, 1.186680072, 3.281075174, 2.233877623],
    ColourGrips_Lum=[0.1, 0.5],
    ColourGrips_Range=[1.596436378, 1.596436378, 1.596436378, 1.596436378],
    ColourGrips_Sat=[0.2, 0.6])
vdisex = VectorDisplayEx(Point=demesh_5.Vertices, Vector=expr("x*0.2", hops_13.MappedVectors), Colour=wheel, Width=1)

index_7 = Slider(3, range=0..20)
demorock_5 = Mesh(internalizeddemorock)
X_7 = UnitX(Factor="6")
multiplication_7 = Multiplication(A=X_7, B=index_7)
move_11 = Move(Geometry=demorock_5, Motion=multiplication_7)  # -> Geometry, Transform
popgeo_3 = PopulateGeometry(Geometry=move_11.Geometry, Count=Slider(2000, range=0..10000), Seed=1)
meshcp_2 = MeshClosestPoint(Point=popgeo_3, Mesh=move_11.Geometry)  # -> Point, Index, Parameter
meval_2 = MeshEval(Mesh=move_11.Geometry, Parameter=meshcp_2.Parameter)  # -> Point, Normal, Colour

panel_17 = Panel("http://localhost:5000/open3d.BallPivotingMeshNormals")
hops_14 = Hops(
    Points=meval_2.Point,
    Normals=meval_2.Normal,
    Triangles=100000,
    CacheResultsInMemory=False,
    CacheSolveResults=False,
    RemoteDefinitionLocation="http://localhost:5000/open3d.BallPivotingMeshNormals",
    RemoteSolveVersion=(0, 1, 0),
    ShowInput_Enabled=False,
    ShowInput_Path=False,
    SynchronousSolve=False)

preview_9 = CustomPreview(Geometry=hops_14, Material=ColourSwatch(SwatchColor=RGB(159, 224, 227)))

index_8 = Slider(6, range=0..20)
X_8 = UnitX(Factor="6")
demorock_6 = Mesh(internalizeddemorock)
multiplication_8 = Multiplication(A=X_8, B=index_8)
move_12 = Move(Geometry=demorock_6, Motion=multiplication_8)  # -> Geometry, Transform
wbsplitquads_2 = WeaverbirdsConstantQuadsSplitSubdivision(MeshCurves=move_12.Geometry, Level=2, SmoothNakedEdges=1)
tri = Triangulate(Mesh=wbsplitquads_2)  # -> Mesh, Count

# ----
# http://localhost:5000/intri.IntrinsicTriangulation
hops_15 = Hops(
    Mesh=tri.Mesh,
    CacheResultsInMemory=False,
    CacheSolveResults=False,
    RemoteDefinitionLocation="http://localhost:5000/intri.IntrinsicTriangulation",
    RemoteSolveVersion=(0, 1, 0),
    ShowInput_Enabled=False,
    ShowInput_Path=False,
    SynchronousSolve=False)

demorock_intrinsic = Mesh(hops_15)
preview_10 = CustomPreview(Geometry=demorock_intrinsic, Material=ColourSwatch(SwatchColor=RGB(159, 224, 227)))

internalizedstanfordbunnyremeshed_4 = Mesh(internalizedstanfordbunnyremeshed)
index_9 = Slider(15, range=0..20)
X_9 = UnitX(Factor="6")
multiplication_9 = Multiplication(A=X_9, B=index_9)
move_13 = Move(Geometry=internalizedstanfordbunnyremeshed_4, Motion=multiplication_9)  # -> Geometry, Transform
source_c_3 = Slider(729, range=0..1000)
source_a_3 = Slider(688, range=0..1000)
source_b_3 = Slider(408, range=0..1000)
scalar_a = Slider(5, range=0..10)
scalar_b = Slider(1, range=0..10)
scalar_c = Slider(3, range=0..10)
demesh_6 = DeconstructMesh(Mesh=move_13.Geometry)  # -> Vertices, Faces, Colours, Normals
merge_5 = Merge(Data1=source_a_3, Data2=source_b_3, Data3=source_c_3)
merge_6 = Merge(Data1=scalar_a, Data2=scalar_b, Data3=scalar_c)
item_3 = ListItem(List=demesh_6.Vertices, Index=merge_5, Wrap=True)
dots_3 = DotDisplay(Point=item_3, Colour=RGB(0, 0, 0), Size=0.1)

panel_18 = Panel("http://localhost:5000/pp3d.MeshVectorHeatExtendScalar")
hops_16 = Hops(
    Mesh=move_13.Geometry,
    Sources=merge_5,
    Values=merge_6,
    TextureScale=1,
    CacheResultsInMemory=False,
    CacheSolveResults=False,
    RemoteDefinitionLocation="http://localhost:5000/pp3d.MeshVectorHeatExtendScalar",
    RemoteSolveVersion=(0, 1, 0),
    ShowInput_Enabled=False,
    ShowInput_Path=False,
    SynchronousSolve=True)  # -> Mesh, ExtendedScalars, NormalizedValues

extendedscalars = Number(hops_16.NormalizedValues)
gradient_2 = Gradient(
    LowerLimit=1,
    UpperLimit=0,
    Parameter=extendedscalars,
    stops=[0: RGB(234, 38, 0), 0.25: RGB(234, 126, 0), 0.5: RGB(254, 244, 84), 0.75: RGB(173, 203, 249), 1: RGB(75, 107, 169)])
conmesh_2 = ConstructMesh(Vertices=demesh_6.Vertices, Faces=demesh_6.Faces, Colours=gradient_2)
preview_11 = CustomPreview(
    Geometry=conmesh_2,
    Material={diffuse=RGB(221, 160, 221), emission=RGB(66, 48, 66), shine=0.5, specular=RGB(255, 255, 255), transparency=0})

index_10 = Slider(2, range=0..20)
X_10 = UnitX(Factor="6")
demorock_7 = Mesh(internalizeddemorock)
multiplication_10 = Multiplication(A=X_10, B=index_10)
move_14 = Move(Geometry=demorock_7, Motion=multiplication_10)  # -> Geometry, Transform
popgeo_4 = PopulateGeometry(Geometry=move_14.Geometry, Count=Slider(2000, range=0..10000), Seed=1)

panel_19 = Panel("http://localhost:5000/open3d.BallPivotingMesh")
hops_17 = Hops(
    Points=popgeo_4,
    Depth=100000,
    CacheResultsInMemory=False,
    CacheSolveResults=False,
    RemoteDefinitionLocation="http://localhost:5000/open3d.BallPivotingMesh",
    RemoteSolveVersion=(0, 1, 0),
    ShowInput_Enabled=False,
    ShowInput_Path=False,
    SynchronousSolve=False)

preview_12 = CustomPreview(Geometry=hops_17, Material=ColourSwatch(SwatchColor=RGB(159, 224, 227)))

demorock_8 = Mesh(internalizeddemorock)
X_11 = UnitX(Factor="0")
move_15 = Move(Geometry=demorock_8, Motion=X_11)  # -> Geometry, Transform
demesh_7 = DeconstructMesh(Mesh=move_15.Geometry)  # -> Vertices, Faces, Colours, Normals

panel_20 = Panel("http://localhost:5000/open3d.ConvexHull")
hops_18 = Hops(
    Points=demesh_7.Vertices,
    CacheResultsInMemory=False,
    CacheSolveResults=False,
    RemoteDefinitionLocation="http://localhost:5000/open3d.ConvexHull",
    RemoteSolveVersion=(0, 1, 0),
    ShowInput_Enabled=False,
    ShowInput_Path=False,
    SynchronousSolve=False)

preview_13 = CustomPreview(Geometry=hops_18, Material=ColourSwatch(SwatchColor=RGB(159, 224, 227)))

demorock_intrinsic_2 = Mesh(demorock_intrinsic)
X_12 = UnitX(Factor="6")
move_16 = Move(Geometry=demorock_intrinsic_2, Motion=X_12)  # -> Geometry, Transform
demesh_8 = DeconstructMesh(Mesh=move_16.Geometry)  # -> Vertices, Faces, Colours, Normals

# ----
# http://localhost:5000/intri.HeatMethodDistance
number_slider_3 = Slider(120, range=0..1000)
hops_19 = Hops(
    Mesh=move_16.Geometry,
    SourceVertex=number_slider_3,
    TextureScale=1,
    CacheResultsInMemory=False,
    CacheSolveResults=False,
    RemoteDefinitionLocation="http://localhost:5000/intri.HeatMethodDistance",
    RemoteSolveVersion=(0, 1, 0),
    ShowInput_Enabled=False,
    ShowInput_Path=False,
    SynchronousSolve=True)  # -> Mesh, Distances, Values

heatvalues_2 = Number(hops_19.Values)
gradient_3 = Gradient(
    LowerLimit=1,
    UpperLimit=0,
    Parameter=heatvalues_2,
    stops=[0: RGB(243, 57, 0), 0.1: RGB(236, 27, 60), 0.2: RGB(210, 0, 118), 0.3: RGB(103, 0, 120), 0.4: RGB(39, 72, 161), 0.5: RGB(1, 192, 229), 0.6: RGB(18, 178, 90), 0.7: RGB(79, 186, 8), 0.8: RGB(220, 237, 32), 0.9: RGB(247, 159, 20), 1: RGB(243, 57, 0)])
conmesh_3 = ConstructMesh(Vertices=demesh_8.Vertices, Faces=demesh_8.Faces, Colours=gradient_3)
item_4 = ListItem(List=demesh_8.Vertices, Index=number_slider_3, Wrap=True)
dots_4 = DotDisplay(Point=item_4, Colour=RGB(0, 0, 0), Size=0.1)
preview_14 = CustomPreview(
    Geometry=conmesh_3,
    Material={diffuse=RGB(221, 160, 221), emission=RGB(66, 48, 66), shine=0.5, specular=RGB(255, 255, 255), transparency=0})

stanfordbunnyremeshed = Mesh(conmesh)
X_13 = UnitX(Factor="12")
move_17 = Move(Geometry=stanfordbunnyremeshed, Motion=X_13)  # -> Geometry, Transform
preview_15 = CustomPreview(
    Geometry=move_17.Geometry,
    Material={diffuse=RGB(221, 160, 221), emission=RGB(66, 48, 66), shine=0.5, specular=RGB(255, 255, 255), transparency=0})

# ----
# http://localhost:5000/igl.MeshIsocurves
number_slider_4 = Slider(50, range=0..100)
heatvalues_3 = Number(heatvalues)
hops_20 = Hops(
    Mesh=move_17.Geometry,
    Values=heatvalues_3,
    Count=number_slider_4,
    CacheResultsInMemory=False,
    CacheSolveResults=False,
    RemoteDefinitionLocation="http://localhost:5000/igl.MeshIsocurves",
    RemoteSolveVersion=(0, 1, 0),
    ShowInput_Enabled=False,
    ShowInput_Path=False,
    SynchronousSolve=False)  # -> VertexPositions, EdgePositions

partition_3 = PartitionList(List=hops_20.EdgePositions, Size="2")  # -> simplify(Chunks)
item_5 = ListItem(List=hops_20.VertexPositions, Index=partition_3, Wrap=True)
item_6 = ListItem(List=item_5, Index=0, Wrap=True)  # -> Item, Item1
ln = Line(StartPoint=item_6.Item, EndPoint=item_6.Item1)
join = JoinCurves(Curves=flatten(ln), Preserve=False)
preview_16 = CustomPreview(Geometry=join, Material=ColourSwatch(SwatchColor=RGB(255, 255, 255)))

demorock_intrinsic_3 = Mesh(conmesh_3)
X_14 = UnitX(Factor="6")
move_18 = Move(Geometry=demorock_intrinsic_3, Motion=X_14)  # -> Geometry, Transform
preview_17 = CustomPreview(
    Geometry=move_18.Geometry,
    Material={diffuse=RGB(221, 160, 221), emission=RGB(66, 48, 66), shine=0.5, specular=RGB(255, 255, 255), transparency=0})

# ----
# http://localhost:5000/igl.MeshIsocurves
number_slider_5 = Slider(25, range=0..100)
heatvalues_4 = Number(heatvalues_2)
hops_21 = Hops(
    Mesh=move_18.Geometry,
    Values=heatvalues_4,
    Count=number_slider_5,
    CacheResultsInMemory=False,
    CacheSolveResults=False,
    RemoteDefinitionLocation="http://localhost:5000/igl.MeshIsocurves",
    RemoteSolveVersion=(0, 1, 0),
    ShowInput_Enabled=False,
    ShowInput_Path=False,
    SynchronousSolve=False)  # -> VertexPositions, EdgePositions

partition_4 = PartitionList(List=hops_21.EdgePositions, Size="2")  # -> simplify(Chunks)
item_7 = ListItem(List=hops_21.VertexPositions, Index=partition_4, Wrap=True)
item_8 = ListItem(List=item_7, Index=0, Wrap=True)  # -> Item, Item1
ln_2 = Line(StartPoint=item_8.Item, EndPoint=item_8.Item1)
join_2 = JoinCurves(Curves=flatten(ln_2), Preserve=False)
preview_18 = CustomPreview(Geometry=join_2, Material=ColourSwatch(SwatchColor=RGB(255, 255, 255)))
