# Grasshopper definition 221123_MALT_ContourDetection.gh (Grasshopper 1.0.7)
# plug-ins: Hops

# ----
# comments & notes: You should not need to do anything here. This component will load the xform.yml file and read the transformation matrix from it.
panel = Panel("http://localhost:5000/opencv.LoadCameraXForm")
hops = Hops(
    _Path=panel,
    CacheResultsInMemory=False,
    CacheSolveResults=False,
    RemoteDefinitionLocation="http://localhost:5000/opencv.LoadCameraXForm",
    RemoteSolveVersion=(0, 1, 0),
    ShowInput_Enabled=False,
    ShowInput_Path=True,
    SynchronousSolve=True)  # -> Log, Transform
panel_2 = Panel(hops.Log)
panel_3 = Panel(hops.Transform)

# ----
# comments & notes: Contour Recoginition & Detection Settings
width = Slider(1131, range=0..10000)
height = Slider(1131, range=0..10000)

# ----
# comments & notes: Right click > Set local image to run the contour detection (does not work with internalized data...)
panel_4 = Panel("http://localhost:5000/opencv.DetectContoursFile")
image_resource = ImageResource("C:\Users\EFESTWIN\source\repos\malt\src\malt\imgprocessing\imgs_undistorted\DSC05574.JPG")
chainapproximation = Slider(1, range=0..3)
extonly = BooleanToggle(True)
invert = BooleanToggle(False)
width_2 = Data(width)
height_2 = Data(height)
hops_2 = Hops(
    _Path=panel_4,
    Run=Toggle(True),
    FilePath=image_resource,
    BinaryThreshold=Slider(175, range=0..255),
    AreaThreshold=Slider(500, range=0..6000),
    Width=width_2,
    Height=height_2,
    ChainApproximation=chainapproximation,
    Invert=invert,
    ExtOnly=extonly,
    Transform=panel_3,
    CacheResultsInMemory=False,
    CacheSolveResults=False,
    RemoteDefinitionLocation="http://localhost:5000/opencv.DetectContoursFile",
    RemoteSolveVersion=(0, 1, 0),
    ShowInput_Enabled=False,
    ShowInput_Path=True,
    SynchronousSolve=False)  # -> Boundary, Contours
number_slider = Slider(0, range=0..360)
scale = Scale(Geometry=hops_2.Contours, Center=Point(0, 0, 0), Factor=Slider(1, range=0.01..1))  # -> Geometry, Transform
data = Data(hops_2.Boundary)
Y = UnitY(Factor=Slider(0, range=-2000..2000))
Z = UnitZ(Factor=Slider(0, range=-2000..2000))
X = UnitX(Factor=Slider(0, range=-2000..2000))
rotate = Rotate(Geometry=data, Angle=degrees(number_slider), Plane=PlaneXY(0, 0, 0))  # -> Geometry, Transform
rotate_2 = Rotate(Geometry=scale.Geometry, Angle=degrees(number_slider), Plane=PlaneXY(0, 0, 0))  # -> Geometry, Transform
addition = Addition(A=Y, B=X, C=Z)
move = Move(Geometry=rotate_2.Geometry, Motion=addition)  # -> Geometry, Transform
move_2 = Move(Geometry=rotate.Geometry, Motion=addition)  # -> Geometry, Transform
contour_curves = Curve(move.Geometry)
preview = CustomPreview(Geometry=move.Geometry, Material=ColourSwatch(SwatchColor=RGB(0, 0, 0)))
preview_2 = CustomPreview(Geometry=move_2.Geometry, Material=ColourSwatch(SwatchColor=RGB(255, 0, 0)))
