# Grasshopper definition 230118_MALT_ContourDetection.gh (Grasshopper 1.0.7)
# plug-ins: Hops

# ----
# comments & notes: You should not need to do anything here. This component will load the xform.yml file and read the transformation matrix from it.
panel = Panel("http://localhost:5000/opencv.LoadCameraXForm")
hops = Hops(
    _Path=panel,
    CacheResultsInMemory=False,
    CacheSolveResults=False,
    RemoteDefinitionLocation="http://localhost:5000/opencv.LoadCameraXForm",
    RemoteSolveVersion=(0, 1, 0),
    ShowInput_Enabled=False,
    ShowInput_Path=True,
    SynchronousSolve=True)  # -> Log, Transform
panel_2 = Panel(hops.Log)
panel_3 = Panel(hops.Transform)

# ----
# comments & notes: Contour Recoginition & Detection Settings
width = Slider(1131, range=0..10000)
height = Slider(1131, range=0..10000)

path = FilePath("C:\Users\EFESTWIN\source\repos\malt\src\malt\imgprocessing\imgs_undistorted\")
panel_4 = Panel(path)
python = GhPythonScript(DIR=panel_4)  # -> out, IMGS
# ---------- python: Python ----------
__author__ = "EFESTWIN"
__version__ = "2023.01.18"

import rhinoscriptsyntax as rs
import glob
import os

img_types = ['*.jpg', '*.png', '*.jpeg']
IMGS = []
for it in img_types:
    IMGS.extend(glob.glob(os.path.join(DIR, it)))
# ---------- end python ----------

cameraxform = Data(panel_3)

# ----
# comments & notes: Right click > "Select a Directory" to run the contour detection on all images in that directory
path_2 = FilePath("C:\Users\EFESTWIN\source\repos\malt\src\malt\imgprocessing\imgs_undistorted\")
panel_5 = Panel(path_2)
chainapproximation = Slider(1, range=0..3)
extonly = BooleanToggle(True)
invert = BooleanToggle(False)
cameraxform_2 = Data(cameraxform)
width_2 = Data(width)
height_2 = Data(height)
hops_2 = Hops(
    _Path="http://localhost:5000/opencv.DetectContoursFileMulti",
    Run=Toggle(False),
    Directory=panel_5,
    BinaryThreshold=Slider(137, range=-1..255),
    AreaThreshold=Slider(500, range=0..6000),
    Width=width_2,
    Height=height_2,
    ChainApproximation=chainapproximation,
    Epsilon=Slider(0.001, range=0..1),
    Invert=invert,
    ExtOnly=extonly,
    Transform=cameraxform_2,
    CacheResultsInMemory=False,
    CacheSolveResults=False,
    RemoteDefinitionLocation="http://localhost:5000/opencv.DetectContoursFileMulti",
    RemoteSolveVersion=(0, 1, 0),
    ShowInput_Enabled=False,
    ShowInput_Path=True,
    SynchronousSolve=False)  # -> Boundary, Contours, QRData
boundarycurve = Data(hops_2.Boundary)
contour_curves = Curve(hops_2.Contours)
qrdata = Data(hops_2.QRData)
branchindex = Slider(19, range=0..25)
datatree = Data(contour_curves)
datatree_2 = Data(qrdata)
tstat = TreeStatistics(Tree=datatree)  # -> Paths, Length, Count
tstat_2 = TreeStatistics(Tree=datatree_2)  # -> Paths, Length, Count
item = ListItem(List=tstat.Paths, Index=branchindex, Wrap=True)
item_2 = ListItem(List=tstat_2.Paths, Index=branchindex, Wrap=True)
branch = TreeBranch(Tree=datatree, Path=item, MaintainPaths=True)
branch_2 = TreeBranch(Tree=datatree_2, Path=item_2, MaintainPaths=True)
area = Area(Geometry=branch)  # -> Area, Centroid
item_3 = ListItem(List=area.Centroid, Index=0, Wrap=True)
preview = CustomPreview(Geometry=branch, Material=ColourSwatch(SwatchColor=RGB(0, 0, 0)))
preview_2 = CustomPreview(Geometry=boundarycurve, Material=ColourSwatch(SwatchColor=RGB(255, 0, 0)))
tag = TextTag3D(Location=item_3, Text=branch_2, Size=Slider(8, range=0..10), Justification=5)

# ----
# comments & notes: Right click > Set local image to run the contour detection (does not work with internalized data...)
panel_6 = Panel("http://localhost:5000/opencv.DetectContoursFile")
image_resource = ImageResource("C:\Users\EFESTWIN\source\repos\malt\src\malt\imgprocessing\imgs_undistorted\DSC_0002.jpg")
chainapproximation_2 = Slider(1, range=0..3)
extonly_2 = BooleanToggle(True)
invert_2 = BooleanToggle(False)
cameraxform_3 = Data(cameraxform)
width_3 = Data(width)
height_3 = Data(height)
hops_3 = Hops(
    _Path=panel_6,
    Run=Toggle(False),
    FilePath=image_resource,
    BinaryThreshold=Slider(137, range=-1..255),
    AreaThreshold=Slider(500, range=0..6000),
    Width=width_3,
    Height=height_3,
    ChainApproximation=chainapproximation_2,
    Epsilon=Slider(0.001, range=0..1),
    Invert=invert_2,
    ExtOnly=extonly_2,
    Transform=cameraxform_3,
    CacheResultsInMemory=False,
    CacheSolveResults=False,
    RemoteDefinitionLocation="http://localhost:5000/opencv.DetectContoursFile",
    RemoteSolveVersion=(0, 1, 0),
    ShowInput_Enabled=False,
    ShowInput_Path=True,
    SynchronousSolve=False)  # -> Boundary, Contours, QRData
contour_curves_2 = Curve(hops_3.Contours)
boundarycurve_2 = Data(hops_3.Boundary)
qrdata_2 = Data(hops_3.QRData)
area_2 = Area(Geometry=contour_curves_2)  # -> Area, Centroid
item_4 = ListItem(List=area_2.Centroid, Index=0, Wrap=True)
preview_3 = CustomPreview(Geometry=contour_curves_2, Material=ColourSwatch(SwatchColor=RGB(0, 0, 0)))
preview_4 = CustomPreview(Geometry=boundarycurve_2, Material=ColourSwatch(SwatchColor=RGB(255, 0, 0)))
tag_2 = TextTag3D(Location=item_4, Text=qrdata_2, Size=Slider(8, range=0..10), Justification=5)
